# Grasshopper definition Hops_Twisted transformations_Arushi.gh (Grasshopper 1.0.7)
# plug-ins: Hops

hops = Hops(
    Radius=Slider(15, range=0..100),
    UVCount=Slider(63, range=0..100),
    AxisLength=Slider(36.89, range=0..80),
    Angle=Slider(1000, range=0..1000),
    DeformationsScale=Slider(7, range=0..10),
    Factor=Slider(7, range=0..10),
    CacheResultsInMemory=True,
    CacheSolveResults=True,
    RemoteDefinitionLocation="D:\IAAC CLASS\BIMIntegrative\Submission 1\Twisted transformations_Arushi.gh",
    RemoteSolveVersion=(0, 1, 0),
    ShowInput_Enabled=False,
    ShowInput_Path=False,
    SynchronousSolve=True)
geo = Geometry(hops)
material = CreateMaterial(
    Diffuse=ColourSwatch(SwatchColor=RGB(255, 255, 255)),
    Specular=RGB(255, 255, 255),
    Emission=RGB(0, 0, 0),
    Transparency=0,
    Shine=Slider(100, range=0..100))
preview = CustomPreview(Geometry=geo, Material=material)
