# Grasshopper definition Twisted transformations_Arushi.gh (Grasshopper 1.0.7)
# plug-ins: Weaverbird

uv_count = GetInteger(Slider(71, range=0..100), AtLeast=1, AtMost=1, Maximum=2147483647, Minimum=-2147483648, TreeAccess=False)
radius = GetInteger(Slider(30, range=0..100), AtLeast=1, AtMost=1, Maximum=2147483647, Minimum=-2147483648, TreeAccess=False)
msphere = MeshSphere(Base=PlaneXY(0, 0, 0), Radius=radius, UCount=uv_count, VCount=uv_count)
factor = GetInteger(Slider(4, range=0..10), AtLeast=1, AtMost=1, Maximum=2147483647, Minimum=-2147483648, TreeAccess=False)
deformations_scale = GetNumber(Slider(5.76, range=0..20), AtLeast=1, AtMost=1, Maximum=1.797693135e+308, Minimum=-1.797693135e+308, TreeAccess=False)
angle = GetInteger(Slider(527, range=0..2000), AtLeast=1, AtMost=1, Maximum=2147483647, Minimum=-2147483648, TreeAccess=False)
multiplication = Multiplication(A=deformations_scale, B=factor)
dom = ConstructDomain(DomainStart=deformations_scale, DomainEnd=multiplication)
volume = Volume(Geometry=msphere)  # -> Volume, Centroid

# ---- group: DEFINING AXIS
number_slider = Slider(50, range=0..200)

# ----
axis_length = GetNumber(number_slider, AtLeast=1, AtMost=1, Maximum=1.797693135e+308, Minimum=-1.797693135e+308, TreeAccess=False)

# ---- group: DEFINING AXIS (continued)
neg = Negative(Value=axis_length)
pt = ConstructPoint(XCoordinate=0, YCoordinate=0, ZCoordinate=axis_length)
pt_2 = ConstructPoint(XCoordinate=0, YCoordinate=0, ZCoordinate=neg)

# ----
ln = Line(StartPoint=pt, EndPoint=pt_2)
twist = Twist(Geometry=msphere, Axis=ln, Angle=degrees(angle), Infinite=False, Rigid=False)
demesh = DeconstructMesh(Mesh=twist)  # -> Vertices, Faces, Colours, Normals
facen = FaceNormals(Mesh=twist)  # -> Centers, Normals
dispatch = Dispatch(List=facen.Centers, DispatchPattern=[True, False])  # -> ListA, ListB
lng = ListLength(List=dispatch.ListB)

# ---- group: MOVING POINTS RANDOMLY
vec2pt = Vector2Pt(PointA=volume.Centroid, PointB=dispatch.ListB, Unitize=False)  # -> Vector, Length
random = Random(Range=dom, Number=lng, Seed=2)
amp = Amplitude(Vector=vec2pt.Vector, Amplitude=random)
move = Move(Geometry=dispatch.ListB, Motion=amp)  # -> Geometry, Transform

# ----
pt_3 = Point(dispatch.ListA)
pt_4 = Point(dispatch.ListB)
weave = Weave(Pattern=[0, 1], Stream0=dispatch.ListA, Stream1=move.Geometry, NullGaps=False)
conmesh = ConstructMesh(Vertices=weave, Faces=demesh.Faces)
wbcatmullclark = WeaverbirdsCatmullClarkSubdivision(MeshCurves=conmesh, Level=Slider(2, range=0..10), SmoothNakedEdges=1)
context_bake = ContextBake(Geometry=wbcatmullclark)
preview = CustomPreview(
    Geometry=wbcatmullclark,
    Material={diffuse=RGB(221, 160, 221), emission=RGB(66, 48, 66), shine=0.5, specular=RGB(255, 255, 255), transparency=0})
